% Simulink data dictionary CellVoltageDiagnostics_DD.sldd

Cell_Voltages = Simulink.Signal(StorageClass="ExportedGlobal", DataType="single", InitialValue="3.5")
FaultPresent = Simulink.Signal(StorageClass="ExportedGlobal", DataType="boolean", InitialValue="false")
MaxDeltaCellVoltage = Simulink.Parameter(single(0.5), StorageClass="ExportedGlobal", Unit="V")  % Maximum Allowable Delta Between Cell Voltages
OverCellVoltageLimit = Simulink.Parameter(single(4.1), StorageClass="ExportedGlobal", Unit="V")  % Maximum Allowable Cell Voltage
UnderCellVoltageLimit = Simulink.Parameter(single(2.25), StorageClass="ExportedGlobal", Unit="V")  % Miminum Allowable Cell Voltage
BMS_Configuration_TMS570 = Simulink.ConfigSet(StartTime="0", StopTime="10000", Solver="FixedStepDiscrete", ProdHWDeviceType="Intel->x86-64 (Linux 64)", SystemTargetFile="grt.tlc", TargetLang="C++")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
BMS_Sw_CodeGenConfigSLRT = Simulink.ConfigSet(StartTime="0", StopTime="10000", Solver="FixedStepDiscrete", ProdHWDeviceType="Intel->x86-64 (Linux 64)", SystemTargetFile="slrealtime.tlc", TargetLang="C++")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