% Simulink data dictionary Shared_DD_TMS570.sldd
% references Battery_1Pack_1RC_TMS570.sldd

Faults = Simulink.Bus()
  VoltSensor: boolean
  OverCurrent: boolean
  HighTemp: boolean
  LowTemp: boolean
  OverVolt: boolean
  UnderVolt: boolean
  Charger: boolean
  Inverter: boolean

TestCase = 1
R_bleed = 20
SOCInit = 0.9
Var = 293.15

BMS_Info = Simulink.Bus()
  Faults_Bus: Bus: Faults
  BMS_State: Enum: BMS_State_Enum
  SOC: Bus: SOC_Est

BMS_State_Enum_TMS570 = enum(DefaultValue="BMS_Standby", StorageType="int8")
  BMS_Standby = 0
  BMS_Charging = 1
  BMS_Driving = 2
  BMS_Fault = 3

SRE_TMS570 = enum(DefaultValue="Balancing", StorageType="int8")
  Balancing = 0
  Charging = 1
  Driving = 2